# Grasshopper definition Gcode_Frezer_Simulation.gh (Grasshopper 1.0.7)
# plug-ins: Kangaroo2 Components, Bifocals, Pufferfish

trigger = Trigger(Interval=200, TimerInterval=200, Target=python)  # disabled
srf = Surface(<surface referenced from the Rhino model>)
python = GhPythonScript(state=Toggle(True))  # -> out, a, b; inputs state: Boolean
# ---------- python: Python ----------
from scriptcontext import sticky

if not state:
    sticky["valX"] = 0
    sticky["valY"] = 0
else:
    sticky["valX"] += 1

a = sticky["valX"]

if a % 20 == 0:
    sticky["valY"] += 1
b = sticky["valY"]
# ---------- end python ----------
panel = Panel([python.b, python.a])
Z = UnitZ(Factor=Slider(1.509, range=0..10))
construct_point = ConstructPoint(XCoordinate=0, YCoordinate=0, ZCoordinate=0)
X = UnitX(Factor=Slider(104, range=0..200))
brep = Brep(<brep referenced from the Rhino model>)
brep_2 = Brep(<brep referenced from the Rhino model>)
swatch = ColourSwatch(SwatchColor=RGB(0, 136, 169))
Y = UnitY(Factor=Slider(0, range=0..200))
Z_2 = UnitZ(Factor=Slider(3.594, range=0..10))

# ---- group: Simulation
number_slider = Slider(20, range=0..100)
sdivide = DivideSurface(Surface=srf, UCount=number_slider, VCount=number_slider)  # -> Points, Normals, Parameters
number_slider_2 = Slider(20, range=0..100)
Z_3 = UnitZ(Factor=number_slider_2)

# ----
panel_2 = Panel(sdivide.Points)
python_2 = GhPythonScript(x=sdivide.Points)  # -> out, a; inputs x: tree of Point3d
# ---------- python_2: Python ----------
import ghpythonlib.treehelpers as th
 
x = th.tree_to_list(x)
a = []

i = 0
for col in x:
    for row in col:
        if i % 2 == 0:
            row.reverse()
        i+=1
        for item in row:
            a.append(item)
# ---------- end python_2 ----------
panel_3 = Panel(python_2.a)
intcrv = Interpolate(Vertices=python_2.a, Degree=3, Periodic=False, KnotStyle=1)  # -> Curve, Length, Domain
move = Move(Geometry=intcrv.Curve, Motion=Z)  # -> Geometry, Transform
rotate = Rotate(Geometry=move.Geometry, Angle=Slider(366, range=0..1000), Plane=PlaneXY(0, 0, 0))  # -> Geometry, Transform
move_2 = Move(Geometry=rotate.Geometry, Motion=X)  # -> Geometry, Transform
deconstruct = Deconstruct(Point=panel_3)  # -> XComponent, YComponent, ZComponent
move_3 = Move(Geometry=move_2.Geometry, Motion=Y)  # -> Geometry, Transform
divide = DivideCurve(Curve=move_3.Geometry, Count=Slider(314, range=0..1000), Kinks=False)  # -> Points, Tangents, Parameters
panel_4 = Panel(divide.Points)
concatenate = Concatenate(FragmentA="X", FragmentB=deconstruct.XComponent)
concatenate_2 = Concatenate(FragmentA=" Y", FragmentB=deconstruct.YComponent)
concatenate_3 = Concatenate(FragmentA=" Z", FragmentB=deconstruct.ZComponent)
deconstruct_2 = Deconstruct(Point=divide.Points)  # -> XComponent, YComponent, ZComponent
concatenate_4 = Concatenate(FragmentA="X", FragmentB=deconstruct_2.XComponent)
concatenate_5 = Concatenate(FragmentA=" Y", FragmentB=deconstruct_2.YComponent)
concatenate_6 = Concatenate(FragmentA=" Z", FragmentB=deconstruct_2.ZComponent)
concatenate_7 = Concatenate(B="G1 ", A="F1200 ", Fragment_A=concatenate, Fragment_B=concatenate_2, C=concatenate_3)  # -> flatten(Result)
panel_5 = Panel(concatenate_7)
concatenate_8 = Concatenate(B="G1 ", A="F1200 ", Fragment_A=concatenate_4, Fragment_B=concatenate_5, C=concatenate_6)  # -> flatten(Result)
move_4 = Move(Geometry=intcrv.Curve, Motion=Z_2)  # -> Geometry, Transform
panel_6 = Panel(concatenate_8)
divide_2 = DivideCurve(Curve=move_4.Geometry, Count=Slider(314, range=0..1000), Kinks=False)  # -> Points, Tangents, Parameters
panel_7 = Panel(divide_2.Points)
panel_8 = Panel([panel_3, panel_7, panel_4])

# ---- group: Simulation (continued)
pln = Plane(panel_8)
item = ListItem(List=pln, Index=python.a, Wrap=True)
item_2 = ListItem(List=flatten(item), Index=python.b, Wrap=True)
cyl = Cylinder(Base=item_2, Radius=Slider(10, range=0..50), Length=Slider(20, range=0..50))
cyl_2 = Cylinder(Base=item_2, Radius=Slider(2, range=0..10), Length=number_slider_2)
move_5 = Move(Geometry=cyl, Motion=Z_3)  # -> Geometry, Transform
cap = CapHoles(Brep=cyl_2)
cap_2 = CapHoles(Brep=move_5.Geometry)
bbx = BrepBrep(BrepA=cap_2, BrepB=brep_2)  # -> Curves, Points
panel_9 = Panel(bbx.Curves)
panel_10 = Panel(bbx.Points)
crv = Curve(bbx.Curves)
preview = CustomPreview(
    Geometry=crv,
    Material={diffuse=RGB(221, 160, 221), emission=RGB(66, 48, 66), shine=0.5, specular=RGB(255, 255, 255), transparency=0})

# ----
move_to_point = MoveToPoint(Geometry=brep, PointA=construct_point, PointB=item_2)  # -> Moved, Vector, Transform
mp = MultiPipe(
    Curves=flatten(bbx.Curves),
    NodeSize=Slider(2.7, range=0..10),
    EndOffset=1,
    StrutSize=1,
    Segment=0,
    KinkAngle=0.6,
    CubeFit=0,
    Caps=0)
rec = DataRecorder(bbx.Curves, DataLimit=-10, RecordData=True)
preview_2 = CustomPreview(Geometry=cap_2, Material=swatch)
preview_3 = CustomPreview(Geometry=cap, Material=swatch)
panel_11 = Panel(rec)
preview_4 = CustomPreview(Geometry=mp, Material=ColourSwatch(SwatchColor=RGB(214, 115, 255)))
rec_2 = DataRecorder(bbx.Curves, DataLimit=-10, RecordData=True)
panel_12 = Panel(rec_2)
deconstruct_3 = Deconstruct(Point=divide_2.Points)  # -> XComponent, YComponent, ZComponent
concatenate_9 = Concatenate(FragmentA="X", FragmentB=deconstruct_3.XComponent)
concatenate_10 = Concatenate(FragmentA=" Y", FragmentB=deconstruct_3.YComponent)
concatenate_11 = Concatenate(FragmentA=" Z", FragmentB=deconstruct_3.ZComponent)
concatenate_12 = Concatenate(B="G1 ", A="F1200 ", Fragment_A=concatenate_9, Fragment_B=concatenate_10, C=concatenate_11)  # -> flatten(Result)
panel_13 = Panel(concatenate_12)
panel_14 = Panel([panel_5, panel_6, panel_13])
