# Grasshopper definition surface.gh (Grasshopper 1.0.7)

number_slider = Slider(50, range=0..100)
range = Range(Domain=Domain(0, 1), Steps=number_slider)
range_2 = Range(Domain=Slider(100, range=0..100), Steps=number_slider)
graph = GraphMapper(
    range,
    x0=0,
    x1=1,
    y0=0,
    y1=1,
    container_name="Sine",
    Equation_px=[0, 0.2441219836],
    Equation_py=[0.7381823659, 0.4877550006])
crossref = CrossReference(ListA=range_2, ListB=range_2, CrossMode=1)  # -> ListA, ListB
expression = Expression(u=number_slider, Expression="u + 1")
crossref_2 = CrossReference(ListA=graph, ListB=graph, CrossMode=1)  # -> ListA, ListB
multiplication = Multiplication(A=crossref_2.ListA, B=crossref_2.ListB)
multiplication_2 = Multiplication(A=Slider(50, range=0..100), B=multiplication)
pt = ConstructPoint(XCoordinate=crossref.ListA, YCoordinate=crossref.ListB, ZCoordinate=multiplication_2)
srfgrid = SurfaceFromPoints(Points=flatten(pt), UCount=expression, Interpolate=False)
